# Grasshopper definition llm_requests.gh (Grasshopper 1.0.8)

py3 = Python3Script(input_text="What is the volume of my building?", run=Toggle(True))  # -> out, out_2
# ---------- py3: Python ----------
#r: requests

import requests

url = 'http://localhost:5000/llm_call'
# url = 'http://127.0.0.1:1234'
payload = {'input': input_text}


out = None
if run:
    response = requests.post(url, json=payload)

    if response.status_code == 200:
        data = response.json()
        out = data['response']
    else:
        out = "Failed to connect:"

a = out
# ---------- end py3 ----------
panel = Panel(py3.out_2)
panel_2 = Panel(py3.out)
