# Grasshopper definition llm_requests_windows.gh (Grasshopper 1.0.8)
# plug-ins: Heteroptera, Human UI, Bifocals, ShapeDiverForGrasshopper

sddp = ShapeDiverDocumentPayload({AbsoluteTolerance=0, AngleTolerance=0, DistanceDisplayPrecision=0, GltfVersion="Gltf2", GrasshopperVersion="1.0.0008", InputGroups="{}", OutputGroups="{}", RelativeTolerance=0, RhinoVersion="8.18.25100.11001", UnitSystem=0, VersionCreated="1.26.0.0", VersionSaved="1.26.0.0"})
panel = Panel("how do i bake cookies?")  # disabled
py3 = Python3Script(input_text=panel, run=Toggle(False))  # -> out, out_2; disabled
# ---------- py3: Python ----------
#r: requests

import requests

url = 'http://localhost:5000/llm_call'
payload = {'input': input_text}


out = None
if run:
    response = requests.post(url, json=payload)

    if response.status_code == 200:
        data = response.json()
        out = data['response']
    else:
        out = "Failed to connect:"

a = out
# ---------- end py3 ----------
panel_2 = Panel("san diego, california")  # disabled
toggle = BooleanToggle(False)  # disabled
panel_3 = Panel(py3.out_2)  # disabled
number_slider = Slider(2, range=0..10)  # disabled
number_slider_2 = Slider(10, range=0..10)  # disabled
py3_2 = Python3Script(input_text=panel_2, run=toggle)  # -> out, min_range, max_range, description; disabled
# ---------- py3_2: Python ----------
#r: requests

import requests

url = 'http://localhost:5000/llm_call'
payload = {'input': input_text}


out = None
if run:
    response = requests.post(url, json=payload)

    if response.status_code == 200:
        data = response.json()
        out = data['response']
    else:
        out = "Failed to connect:"


print(out)
# ---------- end py3_2 ----------
panel_4 = Panel("new york")  # disabled
toggle_2 = BooleanToggle(False)  # disabled
panel_5 = Panel(py3_2.description)
python_3_script = Python3Script(input_text=panel_4, run=toggle_2)  # -> out, points; disabled
# ---------- python_3_script: Python ----------
#r: requests

import requests
from ghpythonlib.treehelpers import list_to_tree

url = 'http://localhost:5000/llm_call'
payload = {'input': input_text}


out = None
if run:
    response = requests.post(url, json=payload)

    if response.status_code == 200:
        data = response.json()
        out = data['response']
    else:
        out = "Failed to connect:"

try:
    print(out)
    text = out.splitlines()
    point1 = []
    for t in text:
        t = t.replace("[","")
        t = t.replace("]","")
        print(t)
        x, y = t.split(",")
        point1.append([x,y])

    points = list_to_tree(point1)
except Exception as e:
    # simple print
    print("Caught exception:", e)
    print("Incorrect format")
# ---------- end python_3_script ----------
panel_6 = Panel(py3_2.out)
panel_7 = Panel(py3_2.max_range)
panel_8 = Panel(py3_2.min_range)
number = Number(python_3_script.points)
panel_9 = Panel(number)
number_slider_3 = Slider(3, range=0..10)
construct_point = ConstructPoint(XCoordinate=Slider(23, range=5..30), YCoordinate=0, ZCoordinate=0)
list_item = ListItem(List=panel_9, Index=0, Wrap=True)  # -> Item, Item1
rectangle = Rectangle(Plane=construct_point, XSize=number_slider_3, YSize=number_slider_3, Radius=0)  # -> Rectangle, Length
construct_point_2 = ConstructPoint(XCoordinate=list_item.Item, YCoordinate=list_item.Item1, ZCoordinate=0)  # -> flatten(Point)
list_item_2 = ListItem(List=construct_point_2, Index=0, Wrap=True)  # -> Item, Item1
curve = Curve(rectangle.Rectangle)
area = Area(Geometry=curve)  # -> Area, Centroid
wwr = Panel(".4")
panel_10 = Panel(area.Area)
rectangle_2pt = Rectangle2Pt(Plane=PlaneXY(0, 0, 0), PointA=list_item_2.Item, PointB=list_item_2.Item1, Radius=0)  # -> Rectangle, Length
multiplication = Multiplication(A=wwr, B=area.Area)
area_window_in_m2 = Panel(multiplication)
square_root = SquareRoot(Value=multiplication)
boundary_surfaces = BoundarySurfaces(Edges=curve)
curve_2 = Curve(rectangle_2pt.Rectangle)
division = Division(A=multiplication, B=Slider(2.28, range=0.5..2.7))
boundary_surfaces_2 = BoundarySurfaces(Edges=curve_2)

window_size = Slider(1, range=0..3)
location_of_window = MDSlider(
    SliderMode=0,
    slider_value=Point(0.5264431093, 0.4092927328, 0.5),
    x_domain=Domain(0, 1),
    y_domain=Domain(0, 1),
    z_domain=Domain(0, 1))
gene_pool = GenePool(Decimals=2, Maximum=1, Minimum=0, Value=[0.92, 0.52, 0.37, 0.51])

panel_11 = Panel(division)
panel_12 = Panel(square_root)
data_recorder = DataRecorder(boundary_surfaces_2, DataLimit=-10, RecordData=True)
offset_curve = OffsetCurve(Curve=boundary_surfaces, Distance=Slider(-0.2, range=-0.2..2), Corners=1)
surface = Surface(data_recorder)
evaluate_surface = EvaluateSurface(Surface=reparameterize(offset_curve), Point=location_of_window)  # -> Point, Normal, UDirection, VDirection, Frame
unit_z = UnitZ(Factor=1)
list_item_3 = ListItem(List=surface, Index=number_slider, Wrap=True)
region_difference = RegionDifference(CurvesA=boundary_surfaces, CurvesB=list_item_3)
brep_edges = BrepEdges(Brep=boundary_surfaces)  # -> Naked, Interior, NonManifold
move = Move(Geometry=list_item_3, Motion=unit_z)  # -> Geometry, Transform
brep_edges_2 = BrepEdges(Brep=move.Geometry)  # -> Naked, Interior, NonManifold
point = Point(evaluate_surface.Point)

number_slider_4 = Slider(0.3, range=0..1)
number_slider_5 = Slider(0.3, range=0..1)
negative = Negative(Value=square_root)
division_2 = Division(A=square_root, B="2")
division_3 = Division(A=negative, B="2")
construct_domain = ConstructDomain(DomainStart=division_2, DomainEnd=division_3)
rectangle_2 = Rectangle(Plane=point, XSize=construct_domain, YSize=construct_domain, Radius=0)  # -> Rectangle, Length

join_curves = JoinCurves(Curves=brep_edges_2.Naked, Preserve=False)
join_curves_2 = JoinCurves(Curves=brep_edges.Naked, Preserve=False)
custom_preview = CustomPreview(Geometry=list_item_3, Material=ColourSwatch(SwatchColor=RGB(156, 219, 255)))
rectangle_3 = Rectangle(Plane=point, XSize=square_root, YSize=square_root, Radius=0)  # -> Rectangle, Length
panel_13 = Panel(data_recorder)
panel_14 = Panel(point)
boundary_surfaces_3 = BoundarySurfaces(Edges=region_difference)
area_2 = Area(Geometry=join_curves_2)  # -> Area, Centroid
discontinuity = Discontinuity(Curve=join_curves, Level=1)  # -> Points, Parameters
discontinuity_2 = Discontinuity(Curve=join_curves_2, Level=1)  # -> Points, Parameters
custom_preview_2 = CustomPreview(Geometry=boundary_surfaces_3, Material=ColourSwatch(SwatchColor=RGB(255, 255, 255)))
circle = Circle(Plane=area_2.Centroid, Radius=1)
vector_xyz = VectorXYZ(XComponent=window_size, YComponent=window_size, ZComponent=0)  # -> Vector, Length
area_3 = Area(Geometry=list_item_3)  # -> Area, Centroid
area_4 = Area(Geometry=boundary_surfaces)  # -> Area, Centroid
unit_x = UnitX(Factor=Slider(2, range=0..10))
curve_closest_point = CurveClosestPoint(Point=discontinuity.Points, Curve=circle)  # -> Point, Parameter, Distance
curve_closest_point_2 = CurveClosestPoint(Point=discontinuity_2.Points, Curve=circle)  # -> Point, Parameter, Distance
move_2 = Move(Geometry=point, Motion=vector_xyz.Vector)  # -> Geometry, Transform
move_3 = Move(Geometry=area_3.Centroid, Motion=unit_x)  # -> Geometry, Transform
division_4 = Division(A=area_3.Area, B=area_4.Area)
sort_list = SortList(Keys=curve_closest_point_2.Parameter, ValuesValuesA=discontinuity_2.Points)  # -> Keys, ValuesValuesA
sort_list_2 = SortList(Keys=curve_closest_point.Parameter, ValuesValuesA=discontinuity.Points)  # -> Keys, ValuesValuesA
concatenate = Concatenate(FragmentA="WWR", FragmentB=division_4)
panel_15 = Panel(division_4)
rectangle_2pt_2 = Rectangle2Pt(Plane=PlaneXY(0, 0, 0), PointA=point, PointB=move_2.Geometry, Radius=0)  # -> Rectangle, Length
polyline = PolyLine(Vertices=sort_list_2.ValuesValuesA, Closed=True)
graft_tree = GraftTree(Tree=sort_list_2.ValuesValuesA, IncludeEmptyLists=True, IncludeNullItems=True)
graft_tree_2 = GraftTree(Tree=sort_list.ValuesValuesA, IncludeEmptyLists=True, IncludeNullItems=True)
text_tag_3d = TextTag3D(Location=move_3.Geometry, Text=concatenate, Size=Slider(0.4, range=0..1), Justification=7)
curve_3 = Curve(rectangle_2pt_2.Rectangle)
merge = Merge(Data1=graft_tree_2, Data2=graft_tree)
region_intersection = RegionIntersection(CurvesA=curve_3, CurvesB=offset_curve)
region_difference_2 = RegionDifference(CurvesA=offset_curve, CurvesB=curve_3)
polyline_2 = PolyLine(Vertices=merge, Closed=False)
curve_4 = Curve(region_difference_2)
curve_5 = Curve(region_intersection)
explode = Explode(Curve=curve_5, Recursive=True)  # -> Segments, Vertices
unit_z_2 = UnitZ(Factor=gene_pool)
area_5 = Area(Geometry=curve_5)  # -> Area, Centroid
area_6 = Area(Geometry=boundary_surfaces)  # -> Area, Centroid
extrude = Extrude(Base=explode.Segments, Direction=unit_z_2)
unit_y = UnitY(Factor=1)
unit_x_2 = UnitX(Factor=1)
boundary_surfaces_4 = BoundarySurfaces(Edges=flatten([curve, boundary_surfaces]))
colour_swatch = ColourSwatch(SwatchColor=RGB(120, 241, 255))
colour_swatch_2 = ColourSwatch(SwatchColor=RGB(255, 255, 255))
colour_swatch_3 = ColourSwatch(SwatchColor=RGB(203, 99, 255))
clean_tree = CleanTree(RemoveNulls=True, RemoveInvalid=True, RemoveEmpty=False, Tree=extrude)
boundary_surfaces_5 = BoundarySurfaces(Edges=curve_5)
boundary_surfaces_6 = BoundarySurfaces(Edges=curve_4)
line_sdl = LineSDL(Start=point, Direction=unit_x_2, Length=1)
line_sdl_2 = LineSDL(Start=point, Direction=unit_y, Length=1)
python_3_script_2 = Python3Script(input_text="san diego, california", run=Toggle(False))  # -> out, points; same code as python_3_script
deconstruct_brep = DeconstructBrep(Brep=boundary_surfaces)  # -> Faces, Edges, Vertices
division_5 = Division(A=area_5.Area, B=area_6.Area)
number_2 = Number(python_3_script_2.points)
custom_preview_3 = CustomPreview(Geometry=boundary_surfaces_5, Material=colour_swatch)
custom_preview_4 = CustomPreview(Geometry=boundary_surfaces_6, Material=colour_swatch_2)
concatenate_2 = Concatenate(FragmentA="WWR", FragmentB=division_5)
panel_16 = Panel(number_2)
list_item_4 = ListItem(List=deconstruct_brep.Vertices, Index=Slider(2, range=0..10), Wrap=True)
custom_preview_5 = CustomPreview(Geometry=clean_tree, Material=colour_swatch_3)
custom_preview_6 = CustomPreview(Geometry=boundary_surfaces_4, Material=ColourSwatch(SwatchColor=RGB(145, 140, 140)))
radians = Radians(Degrees="90")
unit_x_3 = UnitX(Factor=1)
unit_x_4 = UnitX(Factor=1)
merge_2 = Merge(Data1=boundary_surfaces_6, Data2=boundary_surfaces_5, Data3=clean_tree)  # -> flatten(Result)
move_4 = Move(Geometry=list_item_4, Motion=unit_x_4)  # -> Geometry, Transform
rotate_3d = Rotate3D(Geometry=merge_2, Angle=radians, Center=Point(0, 0, 0), Axis=unit_x_3)  # -> Geometry, Transform
list_item_5 = ListItem(List=gene_pool, Index=Slider(2, range=0..10), Wrap=True)
panel_17 = Panel(concatenate_2)
panel_18 = Panel(list_item_5)
panel_19 = Panel(division_5)
text_tag_3d_2 = TextTag3D(Location=move_4.Geometry, Text=concatenate_2, Size=Slider(0.4, range=0..1), Justification=7)
concatenate_3 = Concatenate(FragmentA="shading depth in meters: ", FragmentB=panel_18)
toggle_3 = BooleanToggle(False)
create_slider = CreateSlider(ShowBounds=False, ShowTicks=False, ShowTooltip=False, ShowValLabel=True, showLabel=True)
panel_20 = Panel(concatenate_3)
panel_21 = Panel(panel_17)

# ----
# Building Overall View
number_slider_6 = Slider(2, range=0..10)
rectangle_4 = Rectangle(Plane=PlaneXY(0, 0, 0), XSize=number_slider_6, YSize=number_slider_6, Radius=0)  # -> Rectangle, Length
unit_z_3 = UnitZ(Factor=number_slider_6)
extrude_2 = Extrude(Base=rectangle_4.Rectangle, Direction=unit_z_3)
cap_holes = CapHoles(Brep=extrude_2)
number_slider_7 = Slider(207, range=0..1000)
mesh = Mesh(cap_holes)
create_label = CreateLabel(LabelText="Building View", LabelSize=12, Justification=Slider(1, range=0..2))
create_3d_view = Create3DView(
    MeshToDisplay=mesh,
    MeshColors=RGB(255, 0, 0),
    ViewWidth=Slider(200, range=0..1000),
    ViewHeight=Slider(200, range=0..1000))
create_view_box = CreateViewBox(UIElements=create_3d_view, Width=number_slider_7, Height=number_slider_7)
create_border = CreateBorder(
    UIElement=create_view_box,
    BorderThickness=Slider(0.4, range=0.1..4),
    BorderColor=RGB(0, 0, 0),
    CornerRadius=Slider(16, range=1..50))
create_stack = CreateStack(UIElements=[create_label, create_border], Horizontal=Toggle(False))

number_slider_8 = Slider(0, range=0..2)

# ----
# City + Send Button
panel_22 = Panel("Istanbul")
create_text_box = CreateTextBox(Label="Location", DefaultText=panel_22, UpdateButton=invert(True), showLabel=True)
create_button = CreateButton(ButtonName="Send", ButtonStyle=0)
create_stack_2 = CreateStack(UIElements=[create_text_box, create_button], Horizontal=True)

# ----
# Chat - User Message
panel_23 = Panel("[Insert text here]")
create_text_box_2 = CreateTextBox(Label="User Message", DefaultText=panel_23, UpdateButton=invert(True), showLabel=True)
create_button_2 = CreateButton(ButtonName="Send", ButtonStyle=0)
create_stack_3 = CreateStack(UIElements=[create_text_box_2, create_button_2], Horizontal=True)

# ----
# Material Suggestion
panel_24 = Panel("""Brick
Stone
Metal""")
create_pulldown_menu = CreatePulldownMenu(Label="Material Suggestions", ListItems=panel_24, showLabel=True)

# ----
# Create Display Window
number_slider_9 = Slider(800, range=0..1000)
launch_window = LaunchWindow(
    Show=Toggle(False),
    Name="Facade Generator",
    Width=Slider(640, range=0..1000),
    Height=number_slider_9,
    FontFamily="Arial",
    ChildStatus=0,
    EnableHorizScroll=False)

create_text_box_3 = CreateTextBox(Label="User Message", UpdateButton=invert(True), showLabel=True)
create_button_3 = CreateButton(ButtonName="Send", ButtonStyle=0)

# ----
# Unit Geometry
list_item_6 = ListItem(List=rotate_3d.Geometry, Index=0, Wrap=True)  # -> Item, Item1, Item2
merge_3 = Merge(Data1=colour_swatch_2, Data2=colour_swatch, Data3=colour_swatch_3)
panel_25 = Panel(merge_3)
mesh_2 = Mesh([list_item_6.Item, list_item_6.Item1, list_item_6.Item2])

create_text_block = CreateTextBlock(TextSize=12, Justification=2)
create_label_2 = CreateLabel(LabelText="Bot Message", LabelSize=12, Justification=0)
panel_26 = Panel(create_text_box_3)

# ----
# Unit View Window
number_slider_10 = Slider(251, range=0..1000)
create_3d_view_2 = Create3DView(MeshToDisplay=mesh_2, MeshColors=merge_3, ViewWidth=number_slider_10, ViewHeight=Slider(240, range=0..1000))
create_border_2 = CreateBorder(
    UIElement=create_3d_view_2,
    BorderThickness=Slider(0.4, range=0.1..4),
    BorderColor=RGB(0, 0, 0),
    CornerRadius=Slider(16, range=1..50))

# ----
# Unit - MD Slider
number_slider_11 = Slider(180, range=100..400)
create_multidimensional_slider = CreateMultidimensionalSlider(StartingValue=location_of_window)
value_listener = ValueListener(Elements=create_multidimensional_slider, SomeProperty=True)  # -> Values, Indices
adjust_element_positioning = AdjustElementPositioning(
    ElementsToAdjust=create_multidimensional_slider,
    AbsolutePositioning=False,
    Width=number_slider_11,
    Height=number_slider_11)

create_border_3 = CreateBorder(UIElement=create_text_block, BorderThickness=5, BorderColor=RGB(0, 0, 0), CornerRadius=0)

# ----
# Title
number_slider_12 = Slider(1, range=0..2)
create_label_3 = CreateLabel(LabelText="Facade View", LabelSize=12, Justification=number_slider_12)

create_stack_4 = CreateStack(UIElements=[create_text_box_3, create_button_3], Horizontal=True)
value_listener_2 = ValueListener(Elements=create_button, SomeProperty=True)  # -> Values, Indices
data_recorder_2 = DataRecorder(value_listener_2.Values, DataLimit=-10, RecordData=True)
value_listener_3 = ValueListener(Elements=create_text_box, SomeProperty=True)  # -> Values, Indices
launch_window_2 = LaunchWindow(Show=Toggle(False), Name="Control Window", Width=370, Height=400, ChildStatus=0, EnableHorizScroll=False)
value_listener_4 = ValueListener(Elements=create_text_box_3, SomeProperty=True)  # -> Values, Indices
value_listener_5 = ValueListener(Elements=create_button_3, SomeProperty=True)  # -> Values, Indices
panel_27 = Panel(value_listener_5.Values)
panel_28 = Panel(value_listener_3.Values)
stream_freeze_gate = StreamFreezeGate(Data=value_listener_2.Values, PassingSwitch=True)
panel_29 = Panel(stream_freeze_gate)
stream_freeze_gate_2 = StreamFreezeGate(Data=value_listener_3.Values, PassingSwitch=value_listener_2.Values, Freeze=True)
panel_30 = Panel(stream_freeze_gate_2)
python_3_script_3 = Python3Script(city=panel_30, WWR=flatten(panel_21), shading_depth=flatten(panel_20), orientation="south", run=data_recorder_2)  # -> out, answer, numbers; inputs city: String, WWR: String
# ---------- python_3_script_3: Python ----------
#r: requests

import requests
from ghpythonlib.treehelpers import list_to_tree

url = 'http://localhost:5000/llm_call'

input_text = f"I have a midrise apartment building in the city of {city}. This is the current window properties, it has the WWR (window to wall ratio) and shading depth for shading device above the window: {WWR}, {shading_depth}, {orientation} facing orientation"

print(input_text)

payload = {'input': input_text}

out = None
if run:
    response = requests.post(url, json=payload)

    if response.status_code == 200:
        data = response.json()
        out = data['response']
    else:
        out = "Failed to connect:"

answer = out

try:
    print(out)
    text = out.splitlines()
    numbers = [] 
    for i,t in enumerate(text): 
        if i <2: 
            number = t.split(":")[1] 
            numbers.append(number)
            print(number)
except Exception as e:
    # simple print
    print("Caught exception:", e)
    print("Incorrect format")
# ---------- end python_3_script_3 ----------
panel_31 = Panel(python_3_script_3.answer)
panel_32 = Panel(python_3_script_3.out)
panel_33 = Panel(python_3_script_3.numbers)
list_item_7 = ListItem(List=panel_33, Index=0, Wrap=True)  # -> Item, Item1
wwr_2 = Panel(list_item_7.Item)
shading_depth_in_m = Panel(list_item_7.Item1)
panel_34 = Panel(value_listener_4.Values)
add_elements = AddElements(Window=launch_window_2, Elements=flatten([create_stack_4, create_label_2, create_text_block]), DoVLChecking=True)  # -> AddedElements, ElementNames
stream_freeze_gate_3 = StreamFreezeGate(Data=value_listener_4.Values, PassingSwitch=value_listener_5.Values, Freeze=True)
set_textblock_contents = SetTextBlockContents(TextBlockToModify=create_text_block, NewTextBlockContents="ABC")
panel_36 = Panel(value_listener_2.Values)
panel_37 = Panel(stream_freeze_gate_2)
panel_38 = Panel(stream_freeze_gate_3)
adjust_element_positioning_2 = AdjustElementPositioning(ElementsToAdjust=create_border_2, AbsolutePositioning=Toggle(True))
create_slider_2 = CreateSlider(Slider=window_size, ShowBounds=False, ShowTicks=False, ShowTooltip=False, ShowValLabel=True, showLabel=True)
merge_4 = Merge(Data1=create_label_3, Data2=create_border_2, Data3=create_multidimensional_slider)
value_listener_6 = ValueListener(Elements=create_slider_2, SomeProperty=True)  # -> Values, Indices
create_stack_5 = CreateStack(UIElements=merge_4, Horizontal=Toggle(False))
set_slider = SetSlider(UISlider=create_slider_2, Value=value_listener_6.Values)
panel_39 = Panel(value_listener_6.Values)
srf = Surface(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)
panel_40 = Panel("What is the WWR window to wall ratio for a north facing facade building located in Istambul")
area_7 = Area(Geometry=srf)  # -> Area, Centroid
toggle_4 = BooleanToggle(False)
py3_3 = Python3Script(input_area=area_7.Area, run=toggle_4)  # -> out, out_2; inputs input_area: Double
# ---------- py3_3: Python ----------
# requirements: requests


import requests

url = 'http://localhost:5000/get_from_grasshopper'
payload = {'input': str(input_area)}


out = None
if run:
    response = requests.post(url, json=payload)

    if response.status_code == 200:
        out = "Data was sent to AI Assistant"
    else:
        out = "Failed to connect:"

a = out
# ---------- end py3_3 ----------
py3_4 = Python3Script(run=toggle_4)  # -> out, a
# ---------- py3_4: Python ----------
# requirements: requests
import requests

# Define the URL for the Flask server endpoint
url = 'http://127.0.0.1:5000/send_to_grasshopper'

# Initialize the output variable
concept_text = 'Has not been generated yet'

# Check if the script should run
if run:
    try:
        # Send a GET request to the Flask server to fetch the data
        response = requests.get(url)

        # Check the response status code
        if response.status_code == 200:
            concept_text = response.json()
            print(f"Received concept: {concept_text}")
        else:
            out = f"Failed to connect: {response.status_code}"
    except Exception as e:
        out = f"Error: {e}"

# Assign the output to a variable for Grasshopper
a = concept_text
# ---------- end py3_4 ----------
py3_5 = Python3Script(input_text=panel_40, run=Toggle(True))  # -> out, out_2
# ---------- py3_5: Python ----------
# requirements: requests


import requests

url = 'http://localhost:5000/llm_call'
payload = {'input': input_text}


out = None
if run:
    response = requests.post(url, json=payload)

    if response.status_code == 200:
        data = response.json()
        out = data['response']
    else:
        out = "Failed to connect:"

a = out
# ---------- end py3_5 ----------
panel_41 = Panel(py3_4.a)
panel_42 = Panel(py3_3.out_2)
panel_43 = Panel(py3_5.out_2)

# ----
# Bot - City
panel_44 = Panel("")
create_text_block_2 = CreateTextBlock(Text=panel_44, TextSize=12, Justification=number_slider_8)
create_label_4 = CreateLabel(LabelText="Bot Message", LabelSize=12, Justification=number_slider_8)
panel_45 = Panel(panel_31)
set_textblock_contents_2 = SetTextBlockContents(TextBlockToModify=create_text_block_2, NewTextBlockContents=panel_45)

create_scroll_viewer = CreateScrollViewer(
    UIElements=create_text_block_2,
    HorizontalScrollBarVisibility=0,
    VerticalScrollBarVisibility=0,
    Width=Slider(830, range=0..1000),
    Height=Slider(275, range=0..1000))

create_stack_6 = CreateStack(UIElements=[create_label_4, create_scroll_viewer], Horizontal=Toggle(False))

merge_5 = Merge(
    Data3=create_stack_2,
    Data4=create_stack_6,
    Data5=create_pulldown_menu,
    Data13=create_stack,
    Data14=create_stack_5,
    Data15=create_slider_2)
add_elements_2 = AddElements(Window=launch_window, Elements=flatten(merge_5), DoVLChecking=True)  # -> AddedElements, ElementNames
