# Grasshopper definition llm_requests_windows2.gh (Grasshopper 1.0.8)
# plug-ins: Heteroptera, Human UI, Bifocals, ShapeDiverForGrasshopper

sddp = ShapeDiverDocumentPayload({AbsoluteTolerance=0, AngleTolerance=0, DistanceDisplayPrecision=0, GltfVersion="Gltf2", GrasshopperVersion="1.0.0008", InputGroups="{}", OutputGroups="{}", RelativeTolerance=0, RhinoVersion="8.18.25100.11001", UnitSystem=0, VersionCreated="1.26.0.0", VersionSaved="1.26.0.0"})
panel = Panel("how do i bake cookies?")  # disabled
py3 = Python3Script(input_text=panel, run=Toggle(False))  # -> out, out_2; disabled
# ---------- py3: Python ----------
#r: requests

import requests

url = 'http://localhost:5000/llm_call'
payload = {'input': input_text}


out = None
if run:
    response = requests.post(url, json=payload)

    if response.status_code == 200:
        data = response.json()
        out = data['response']
    else:
        out = "Failed to connect:"

a = out
# ---------- end py3 ----------
panel_2 = Panel("san diego, california")  # disabled
toggle = BooleanToggle(False)  # disabled
panel_3 = Panel(py3.out_2)  # disabled
number_slider = Slider(2, range=0..10)  # disabled
number_slider_2 = Slider(10, range=0..10)  # disabled
py3_2 = Python3Script(input_text=panel_2, run=toggle)  # -> out, min_range, max_range, description; disabled
# ---------- py3_2: Python ----------
#r: requests

import requests

url = 'http://localhost:5000/llm_call'
payload = {'input': input_text}


out = None
if run:
    response = requests.post(url, json=payload)

    if response.status_code == 200:
        data = response.json()
        out = data['response']
    else:
        out = "Failed to connect:"


print(out)
# ---------- end py3_2 ----------
panel_4 = Panel("new york")  # disabled
toggle_2 = BooleanToggle(False)  # disabled
panel_5 = Panel(py3_2.description)
python_3_script = Python3Script(input_text=panel_4, run=toggle_2)  # -> out, points; disabled
# ---------- python_3_script: Python ----------
#r: requests

import requests
from ghpythonlib.treehelpers import list_to_tree

url = 'http://localhost:5000/llm_call'
payload = {'input': input_text}


out = None
if run:
    response = requests.post(url, json=payload)

    if response.status_code == 200:
        data = response.json()
        out = data['response']
    else:
        out = "Failed to connect:"

try:
    print(out)
    text = out.splitlines()
    point1 = []
    for t in text:
        t = t.replace("[","")
        t = t.replace("]","")
        print(t)
        x, y = t.split(",")
        point1.append([x,y])

    points = list_to_tree(point1)
except Exception as e:
    # simple print
    print("Caught exception:", e)
    print("Incorrect format")
# ---------- end python_3_script ----------
panel_6 = Panel(py3_2.out)
panel_7 = Panel(py3_2.max_range)
panel_8 = Panel(py3_2.min_range)
number = Number(python_3_script.points)
panel_9 = Panel(number)
number_slider_3 = Slider(3, range=0..10)
construct_point = ConstructPoint(XCoordinate=Slider(23, range=5..30), YCoordinate=0, ZCoordinate=0)
list_item = ListItem(List=panel_9, Index=0, Wrap=True)  # -> Item, Item1
rectangle = Rectangle(Plane=construct_point, XSize=number_slider_3, YSize=number_slider_3, Radius=0)  # -> Rectangle, Length
radians = Radians(Degrees="90")
construct_point_2 = ConstructPoint(XCoordinate=list_item.Item, YCoordinate=list_item.Item1, ZCoordinate=0)  # -> flatten(Point)
unit_x = UnitX(Factor=1)
list_item_2 = ListItem(List=construct_point_2, Index=0, Wrap=True)  # -> Item, Item1
rotate_3d = Rotate3D(Geometry=rectangle.Rectangle, Angle=radians, Center=Point(0, 0, 0), Axis=unit_x)  # -> Geometry, Transform
rectangle_2pt = Rectangle2Pt(Plane=PlaneXY(0, 0, 0), PointA=list_item_2.Item, PointB=list_item_2.Item1, Radius=0)  # -> Rectangle, Length
curve = Curve(rotate_3d.Geometry)
boundary_surfaces = BoundarySurfaces(Edges=rectangle.Rectangle)
curve_2 = Curve(rectangle_2pt.Rectangle)
boundary_surfaces_2 = BoundarySurfaces(Edges=curve_2)

corner_move = Slider(1.8, range=0..10)
location_of_window = MDSlider(SliderMode=0, slider_value=Point(1, 0, 0.5), x_domain=Domain(0, 1), y_domain=Domain(0, 1), z_domain=Domain(0, 1))
gene_pool = GenePool(Decimals=2, Maximum=1, Minimum=0, Value=[0, 0, 0.56, 0])

data_recorder = DataRecorder(boundary_surfaces_2, DataLimit=-10, RecordData=True)
offset_curve = OffsetCurve(Curve=boundary_surfaces, Distance=Slider(-0.2, range=-0.2..2), Corners=1)
surface = Surface(data_recorder)
evaluate_surface = EvaluateSurface(Surface=reparameterize(offset_curve), Point=location_of_window)  # -> Point, Normal, UDirection, VDirection, Frame
unit_z = UnitZ(Factor=1)
list_item_3 = ListItem(List=surface, Index=number_slider, Wrap=True)
region_difference = RegionDifference(CurvesA=boundary_surfaces, CurvesB=list_item_3)
brep_edges = BrepEdges(Brep=boundary_surfaces)  # -> Naked, Interior, NonManifold
move = Move(Geometry=list_item_3, Motion=unit_z)  # -> Geometry, Transform
brep_edges_2 = BrepEdges(Brep=move.Geometry)  # -> Naked, Interior, NonManifold
point = Point(evaluate_surface.Point)
join_curves = JoinCurves(Curves=brep_edges_2.Naked, Preserve=False)
join_curves_2 = JoinCurves(Curves=brep_edges.Naked, Preserve=False)
custom_preview = CustomPreview(Geometry=list_item_3, Material=ColourSwatch(SwatchColor=RGB(156, 219, 255)))
panel_10 = Panel(data_recorder)
panel_11 = Panel(point)
boundary_surfaces_3 = BoundarySurfaces(Edges=region_difference)
area = Area(Geometry=join_curves_2)  # -> Area, Centroid
discontinuity = Discontinuity(Curve=join_curves, Level=1)  # -> Points, Parameters
discontinuity_2 = Discontinuity(Curve=join_curves_2, Level=1)  # -> Points, Parameters
custom_preview_2 = CustomPreview(Geometry=boundary_surfaces_3, Material=ColourSwatch(SwatchColor=RGB(255, 255, 255)))
circle = Circle(Plane=area.Centroid, Radius=1)
vector_xyz = VectorXYZ(XComponent=corner_move, YComponent=corner_move, ZComponent=0)  # -> Vector, Length
area_2 = Area(Geometry=list_item_3)  # -> Area, Centroid
area_3 = Area(Geometry=boundary_surfaces)  # -> Area, Centroid
unit_x_2 = UnitX(Factor=Slider(2, range=0..10))
curve_closest_point = CurveClosestPoint(Point=discontinuity.Points, Curve=circle)  # -> Point, Parameter, Distance
curve_closest_point_2 = CurveClosestPoint(Point=discontinuity_2.Points, Curve=circle)  # -> Point, Parameter, Distance
move_2 = Move(Geometry=area_2.Centroid, Motion=unit_x_2)  # -> Geometry, Transform
move_3 = Move(Geometry=point, Motion=vector_xyz.Vector)  # -> Geometry, Transform
xz_plane = XZPlane(Origin=Point(0, 0, 0))
division = Division(A=area_2.Area, B=area_3.Area)
sort_list = SortList(Keys=curve_closest_point_2.Parameter, ValuesValuesA=discontinuity_2.Points)  # -> Keys, ValuesValuesA
sort_list_2 = SortList(Keys=curve_closest_point.Parameter, ValuesValuesA=discontinuity.Points)  # -> Keys, ValuesValuesA
concatenate = Concatenate(FragmentA="WWR", FragmentB=division)
panel_12 = Panel(division)
rectangle_2pt_2 = Rectangle2Pt(Plane=xz_plane, PointA=point, PointB=move_3.Geometry, Radius=0)  # -> Rectangle, Length
polyline = PolyLine(Vertices=sort_list_2.ValuesValuesA, Closed=True)
graft_tree = GraftTree(Tree=sort_list_2.ValuesValuesA, IncludeEmptyLists=True, IncludeNullItems=True)
graft_tree_2 = GraftTree(Tree=sort_list.ValuesValuesA, IncludeEmptyLists=True, IncludeNullItems=True)
text_tag_3d = TextTag3D(Location=move_2.Geometry, Text=concatenate, Size=Slider(0.4, range=0..1), Justification=7)
curve_3 = Curve(rectangle_2pt_2.Rectangle)
region_difference_2 = RegionDifference(CurvesA=offset_curve, CurvesB=curve_3)
region_intersection = RegionIntersection(CurvesA=curve_3, CurvesB=offset_curve)
merge = Merge(Data1=graft_tree_2, Data2=graft_tree)
polyline_2 = PolyLine(Vertices=merge, Closed=False)
curve_4 = Curve(region_intersection)
curve_5 = Curve(region_difference_2)
explode = Explode(Curve=curve_4, Recursive=True)  # -> Segments, Vertices
unit_z_2 = UnitZ(Factor=gene_pool)
area_4 = Area(Geometry=curve_4)  # -> Area, Centroid
extrude = Extrude(Base=explode.Segments, Direction=unit_z_2)
area_5 = Area(Geometry=boundary_surfaces)  # -> Area, Centroid
unit_y = UnitY(Factor=1)
unit_x_3 = UnitX(Factor=1)
boundary_surfaces_4 = BoundarySurfaces(Edges=flatten([offset_curve, curve]))
clean_tree = CleanTree(RemoveNulls=True, RemoveInvalid=True, RemoveEmpty=False, Tree=extrude)
boundary_surfaces_5 = BoundarySurfaces(Edges=curve_4)
boundary_surfaces_6 = BoundarySurfaces(Edges=curve_5)
line_sdl = LineSDL(Start=point, Direction=unit_x_3, Length=1)
line_sdl_2 = LineSDL(Start=point, Direction=unit_y, Length=1)
python_3_script_2 = Python3Script(input_text="san diego, california", run=Toggle(False))  # -> out, points; same code as python_3_script
deconstruct_brep = DeconstructBrep(Brep=boundary_surfaces)  # -> Faces, Edges, Vertices
division_2 = Division(A=area_4.Area, B=area_5.Area)
number_2 = Number(python_3_script_2.points)
custom_preview_3 = CustomPreview(Geometry=boundary_surfaces_5, Material=ColourSwatch(SwatchColor=RGB(120, 241, 255)))
custom_preview_4 = CustomPreview(Geometry=clean_tree, Material=ColourSwatch(SwatchColor=RGB(203, 99, 255)))
custom_preview_5 = CustomPreview(Geometry=boundary_surfaces_6, Material=ColourSwatch(SwatchColor=RGB(255, 255, 255)))
concatenate_2 = Concatenate(FragmentA="WWR", FragmentB=division_2)
panel_13 = Panel(number_2)
list_item_4 = ListItem(List=deconstruct_brep.Vertices, Index=Slider(2, range=0..10), Wrap=True)
custom_preview_6 = CustomPreview(Geometry=boundary_surfaces_4, Material=ColourSwatch(SwatchColor=RGB(145, 140, 140)))
unit_x_4 = UnitX(Factor=1)
move_4 = Move(Geometry=list_item_4, Motion=unit_x_4)  # -> Geometry, Transform
list_item_5 = ListItem(List=gene_pool, Index=Slider(2, range=0..10), Wrap=True)
panel_14 = Panel(concatenate_2)
panel_15 = Panel(list_item_5)
panel_16 = Panel(division_2)
text_tag_3d_2 = TextTag3D(Location=move_4.Geometry, Text=concatenate_2, Size=Slider(0.4, range=0..1), Justification=7)
concatenate_3 = Concatenate(FragmentA="shading depth in meters: ", FragmentB=panel_15)
panel_17 = Panel(concatenate_3)
panel_18 = Panel(panel_14)
md_slider = MDSlider(
    SliderMode=0,
    slider_value=Point(0.7331480631, 0.4183915301, 0.5),
    x_domain=Domain(0, 1),
    y_domain=Domain(0, 1),
    z_domain=Domain(0, 1))
boolean_toggle = BooleanToggle(False)
construct_point_3 = ConstructPoint(XCoordinate=Slider(30, range=0..100), YCoordinate=0, ZCoordinate=0)
construct_point_4 = ConstructPoint(XCoordinate=Slider(33, range=0..100), YCoordinate=0, ZCoordinate=0)
number_slider_4 = Slider(2, range=0..10)
create_multidimensional_slider = CreateMultidimensionalSlider(StartingValue=md_slider)
line = Line(StartPoint=construct_point_3, EndPoint=construct_point_4)
create_expander = CreateExpander(Open=True)
unit_z_3 = UnitZ(Factor="3")
number_slider_5 = Slider(0, range=0..2)
number_slider_6 = Slider(0.1, range=0.1..3)
rectangle_2 = Rectangle(Plane=PlaneXY(0, 0, 0), XSize=number_slider_4, YSize=number_slider_4, Radius=0)  # -> Rectangle, Length
unit_z_4 = UnitZ(Factor=number_slider_4)
value_listener = ValueListener(Elements=create_multidimensional_slider, SomeProperty=True)  # -> Values, Indices
extrude_2 = Extrude(Base=line, Direction=unit_z_3)
area_6 = Area(Geometry=extrude_2)  # -> Area, Centroid
panel_19 = Panel(area_6.Area)

# ----
# City
panel_20 = Panel("Istanbul")
create_text_box = CreateTextBox(Label="Location", DefaultText=panel_20, UpdateButton=invert(True), showLabel=True)
create_button = CreateButton(ButtonName="Send", ButtonStyle=0)
create_stack = CreateStack(UIElements=[create_text_box, create_button], Horizontal=True)

# ----
# Chat - User Message
panel_21 = Panel("[Insert text here]")
create_text_box_2 = CreateTextBox(Label="User Message", DefaultText=panel_21, UpdateButton=invert(True), showLabel=True)
create_button_2 = CreateButton(ButtonName="Send", ButtonStyle=0)
create_stack_2 = CreateStack(UIElements=[create_text_box_2, create_button_2], Horizontal=True)

# ----
# Material Suggestion
panel_22 = Panel("""Brick
Stone
Metal""")
create_pulldown_menu = CreatePulldownMenu(Label="Material Suggestions", ListItems=panel_22, showLabel=True)

# ----
# Create Display Window
number_slider_7 = Slider(800, range=0..1000)
launch_window = LaunchWindow(
    Show=Toggle(True),
    Name="Facade Generator",
    Width=Slider(640, range=0..1000),
    Height=number_slider_7,
    FontFamily="Arial",
    ChildStatus=0,
    EnableHorizScroll=False)

multiplication = Multiplication(A=area_6.Area, B="0.4")
panel_23 = Panel(multiplication)
wwr_max = Panel("0.6")
wwr_min = Panel("0.4")

create_text_box_3 = CreateTextBox(Label="User Message", UpdateButton=invert(True), showLabel=True)
create_button_3 = CreateButton(ButtonName="Send", ButtonStyle=0)

extrude_3 = Extrude(Base=rectangle_2.Rectangle, Direction=unit_z_4)
number_slider_8 = Slider(16, range=1..50)
number_slider_9 = Slider(0.4, range=0.1..4)
number_slider_10 = Slider(1.4, range=0.5..2)
division_3 = Division(A=multiplication, B="2")
construct_domain = ConstructDomain(DomainStart=wwr_min, DomainEnd=wwr_max)
evaluate_surface_2 = EvaluateSurface(Surface=extrude_2, Point=value_listener.Values)  # -> Point, Normal, UDirection, VDirection, Frame
area_7 = Area(Geometry=extrude_2)  # -> Area, Centroid
create_text_block = CreateTextBlock(TextSize=12, Justification=2)
mesh = Mesh(extrude_2)
create_label = CreateLabel(LabelText="Bot Message", LabelSize=12, Justification=0)
radians_2 = Radians(Degrees="90")
cap_holes = CapHoles(Brep=extrude_3)
panel_24 = Panel(division_3)
number_slider_11 = Slider(207, range=0..1000)
point_2 = Point(evaluate_surface_2.Point)
panel_25 = Panel(create_text_box_3)
panel_26 = Panel(area_7.Area)
rectangle_3 = Rectangle(Plane=point_2, XSize=number_slider_10, YSize=number_slider_10, Radius=0)  # -> Rectangle, Length
yz_plane = YZPlane(Origin=point_2)
mesh_2 = Mesh(cap_holes)
create_border = CreateBorder(UIElement=create_text_block, BorderThickness=5, BorderColor=RGB(0, 0, 0), CornerRadius=0)
create_stack_3 = CreateStack(UIElements=[create_text_box_3, create_button_3], Horizontal=True)
create_label_2 = CreateLabel(LabelText="Building View", LabelSize=12, Justification=Slider(1, range=0..2))
value_listener_2 = ValueListener(Elements=create_button, SomeProperty=True)  # -> Values, Indices
data_recorder_2 = DataRecorder(value_listener_2.Values, DataLimit=-10, RecordData=True)
value_listener_3 = ValueListener(Elements=create_text_box, SomeProperty=True)  # -> Values, Indices
create_3d_view = Create3DView(
    MeshToDisplay=mesh_2,
    MeshColors=RGB(255, 0, 0),
    ViewWidth=Slider(200, range=0..1000),
    ViewHeight=Slider(200, range=0..1000))
launch_window_2 = LaunchWindow(Show=Toggle(False), Name="Control Window", Width=370, Height=400, ChildStatus=0, EnableHorizScroll=False)
multiplication_2 = Multiplication(A=area_7.Area)
rotate = Rotate(Geometry=rectangle_3.Rectangle, Angle=radians_2, Plane=yz_plane)  # -> Geometry, Transform
value_listener_4 = ValueListener(Elements=create_text_box_3, SomeProperty=True)  # -> Values, Indices
value_listener_5 = ValueListener(Elements=create_button_3, SomeProperty=True)  # -> Values, Indices
panel_27 = Panel(value_listener_5.Values)
create_view_box = CreateViewBox(UIElements=create_3d_view, Width=number_slider_11, Height=number_slider_11)
panel_28 = Panel(value_listener_3.Values)
stream_freeze_gate = StreamFreezeGate(Data=value_listener_3.Values, PassingSwitch=value_listener_2.Values, Freeze=True)
panel_29 = Panel(stream_freeze_gate)
python_3_script_3 = Python3Script(city=panel_29, WWR=flatten(panel_18), shading_depth=flatten(panel_17), orientation="south", run=Toggle(False))  # -> out, answer, numbers; inputs city: String, WWR: String
# ---------- python_3_script_3: Python ----------
#r: requests

import requests
from ghpythonlib.treehelpers import list_to_tree

url = 'http://localhost:5000/llm_call'


input_text = f"I have a midrise apartment building in the city of {city}. This is the current window properties, it has the WWR (window to wall ratio) and shading depth for shading device above the window: {WWR}, {shading_depth}, {orientation} facing orientation"

print(input_text)

payload = {'input': input_text}

out = None
if run:
    response = requests.post(url, json=payload)

    if response.status_code == 200:
        data = response.json()
        out = data['response']
    else:
        out = "Failed to connect:"

answer = out

try:
    print(out)
    text = out.splitlines()
    numbers = [] 
    for i,t in enumerate(text): 
        if i <2: 
            number = t.split(":")[1] 
            numbers.append(number)
            print(number)
except Exception as e:
    # simple print
    print("Caught exception:", e)
    print("Incorrect format")
# ---------- end python_3_script_3 ----------
panel_30 = Panel(python_3_script_3.answer)
panel_31 = Panel(python_3_script_3.out)
panel_32 = Panel(python_3_script_3.numbers)
list_item_6 = ListItem(List=panel_32, Index=0, Wrap=True)  # -> Item, Item1
wwr = Panel(list_item_6.Item)
shading_depth_in_m = Panel(list_item_6.Item1)
mesh_3 = Mesh(rotate.Geometry)
panel_33 = Panel(value_listener_2.Values)
panel_34 = Panel(value_listener_4.Values)
add_elements = AddElements(Window=launch_window_2, Elements=flatten([create_stack_3, create_label, create_text_block]), DoVLChecking=True)  # -> AddedElements, ElementNames
stream_freeze_gate_2 = StreamFreezeGate(Data=value_listener_4.Values, PassingSwitch=value_listener_5.Values, Freeze=True)
set_textblock_contents = SetTextBlockContents(TextBlockToModify=create_text_block, NewTextBlockContents="ABC")
mesh_difference = MeshDifference(MeshesA=mesh, MeshesB=mesh_3)
create_border_2 = CreateBorder(
    UIElement=create_view_box,
    BorderThickness=Slider(0.4, range=0.1..4),
    BorderColor=RGB(0, 0, 0),
    CornerRadius=Slider(16, range=1..50))
panel_36 = Panel(stream_freeze_gate)
panel_37 = Panel(stream_freeze_gate_2)
create_stack_4 = CreateStack(UIElements=[create_label_2, create_border_2], Horizontal=Toggle(False))
create_label_3 = CreateLabel(LabelText="Facade View", LabelSize=12, Justification=Slider(1, range=0..2))
create_3d_view_2 = Create3DView(
    MeshToDisplay=mesh_difference,
    MeshColors=ColourSwatch(SwatchColor=RGB(44, 228, 245)),
    ViewWidth=Slider(200, range=0..1000),
    ViewHeight=Slider(200, range=0..1000))
create_border_3 = CreateBorder(
    UIElement=create_3d_view_2,
    BorderThickness=Slider(0.4, range=0.1..4),
    BorderColor=RGB(0, 0, 0),
    CornerRadius=Slider(16, range=1..50))
create_stack_5 = CreateStack(UIElements=[create_label_3, create_border_3, create_multidimensional_slider], Horizontal=Toggle(False))
set_3d_view = Set3DView()

# ----
# Chat - Bot Message
panel_38 = Panel("")
create_text_block_2 = CreateTextBlock(Text=panel_38, TextSize=12, Justification=number_slider_5)
create_label_4 = CreateLabel(LabelText="Bot Message", LabelSize=12, Justification=number_slider_5)
panel_39 = Panel(panel_30)
set_textblock_contents_2 = SetTextBlockContents(TextBlockToModify=create_text_block_2, NewTextBlockContents=panel_39)

create_scroll_viewer = CreateScrollViewer(
    UIElements=create_text_block_2,
    HorizontalScrollBarVisibility=0,
    VerticalScrollBarVisibility=0,
    Width=Slider(894, range=0..1000),
    Height=Slider(205, range=0..1000))

create_stack_6 = CreateStack(UIElements=[create_label_4, create_scroll_viewer], Horizontal=Toggle(False))

merge_2 = Merge(
    Data3=create_stack,
    Data4=create_stack_6,
    Data5=create_pulldown_menu,
    Data6=create_stack_2,
    Data12=create_stack_5,
    Data13=create_stack_4)
add_elements_2 = AddElements(Window=launch_window, Elements=flatten(merge_2), DoVLChecking=True)  # -> AddedElements, ElementNames
